# Dynamo graph Occupancy Load_CustomNode_v1.1.0.dyn (Dynamo 1.1.0.2094)

# group: Inputs
categories = Categories("Areas")
load_factor_parameter_name = StringInput("AR_OccupantLoadFactorTagged_PW")
occupant_load_parameter_name = StringInput("AR_OccupantLoadTagged_PW")

all_elements_of_category = ElementsOfCategory(categories)
calculate_occupant_load = Custom[Calculate Occupant Load](RoomsOrAreas=all_elements_of_category, LoadFactorParameterName=load_factor_parameter_name, OccupantLoadParameterName=occupant_load_parameter_name)  # Calculates the occupant load for all areas or rooms in a Revit project.
